test file "TestFile"

suite "Voter_TestKit"

  case "Voter_A_AB_less0" [simulation]
    model Control_model, harness PedalVoter_Harness (for Control_model/PedalVoter), stop time 1
    test sequence scenario: A_AB_less0 (PedalVoter_Harness/Test Sequence)

  case "Voter_A_AB_over1" [simulation]
    model Control_model, harness PedalVoter_Harness (for Control_model/PedalVoter), stop time 1
    test sequence scenario: A_AB_over1 (PedalVoter_Harness/Test Sequence)

  case "Voter_A_AC_less0" [simulation]
    model Control_model, harness PedalVoter_Harness (for Control_model/PedalVoter), stop time 1
    test sequence scenario: A_AC_less0 (PedalVoter_Harness/Test Sequence)

  case "Voter_A_AC_over1" [simulation]
    model Control_model, harness PedalVoter_Harness (for Control_model/PedalVoter), stop time 1
    test sequence scenario: A_AC_over1 (PedalVoter_Harness/Test Sequence)

  case "Voter_B_BA_less0" [simulation]
    model Control_model, harness PedalVoter_Harness (for Control_model/PedalVoter), stop time 1
    test sequence scenario: B_BA_less0 (PedalVoter_Harness/Test Sequence)

  case "Voter_B_BA_over1" [simulation]
    model Control_model, harness PedalVoter_Harness (for Control_model/PedalVoter), stop time 1
    test sequence scenario: B_BA_over1 (PedalVoter_Harness/Test Sequence)

  case "Voter_B_BC_less0" [simulation]
    model Control_model, harness PedalVoter_Harness (for Control_model/PedalVoter), stop time 1
    test sequence scenario: B_BC_less0 (PedalVoter_Harness/Test Sequence)

  case "Voter_B_BC_over1" [simulation]
    model Control_model, harness PedalVoter_Harness (for Control_model/PedalVoter), stop time 1
    test sequence scenario: B_BC_over1 (PedalVoter_Harness/Test Sequence)

  case "Voter_C_AC_less0" [simulation]
    model Control_model, harness PedalVoter_Harness (for Control_model/PedalVoter), stop time 1
    test sequence scenario: C_AC_less0 (PedalVoter_Harness/Test Sequence)

  case "Voter_C_AC_over1" [simulation]
    model Control_model, harness PedalVoter_Harness (for Control_model/PedalVoter), stop time 1
    test sequence scenario: C_AC_over1 (PedalVoter_Harness/Test Sequence)

  case "Voter_C_BC_less0" [simulation]
    model Control_model, harness PedalVoter_Harness (for Control_model/PedalVoter), stop time 1
    test sequence scenario: C_BC_less0 (PedalVoter_Harness/Test Sequence)

  case "Voter_C_BC_over1" [simulation]
    model Control_model, harness PedalVoter_Harness (for Control_model/PedalVoter), stop time 1
    test sequence scenario: C_BC_over1 (PedalVoter_Harness/Test Sequence)

  case "Voter_A_AB" [simulation]
    model Control_model, harness PedalVoter_Harness (for Control_model/PedalVoter), stop time 1
    test sequence scenario: A_AB (PedalVoter_Harness/Test Sequence)

  case "Voter_A_AC" [simulation]
    model Control_model, harness PedalVoter_Harness (for Control_model/PedalVoter), stop time 1
    test sequence scenario: A_AC (PedalVoter_Harness/Test Sequence)

  case "Voter_B_BA" [simulation]
    model Control_model, harness PedalVoter_Harness (for Control_model/PedalVoter), stop time 1
    test sequence scenario: B_BA (PedalVoter_Harness/Test Sequence)

  case "Voter_B_BC" [simulation]
    model Control_model, harness PedalVoter_Harness (for Control_model/PedalVoter), stop time 1
    test sequence scenario: B_BC (PedalVoter_Harness/Test Sequence)

  case "Voter_C_CA" [simulation]
    model Control_model, harness PedalVoter_Harness (for Control_model/PedalVoter), stop time 1
    test sequence scenario: C_CA (PedalVoter_Harness/Test Sequence)

  case "Voter_C_CB" [simulation]
    model Control_model, harness PedalVoter_Harness (for Control_model/PedalVoter), stop time 1
    test sequence scenario: C_CB (PedalVoter_Harness/Test Sequence)

suite "CANbus_CheckerKit"

  case "Normal Driving" [baseline]
    model Control_model, harness CANChecker_TestHarness (for Control_model/CAN Signal Checker)
    signal scenario: x0Normal_Driving (CANChecker_TestHarness/Harness Inputs)
    baseline "Normal_Driving_Baseline.mat"
      Brake_Pedal_Pressed:1
      AT_Selector_State:1
      Vehicle_Speed_km_h:1: abs tol 1
      CAN_BUS_Fail_Mode:1

  case "BreakCAN_Fail" [baseline]
    model Control_model, harness CANChecker_TestHarness (for Control_model/CAN Signal Checker)
    signal scenario: x1BreakCAN_Fail (CANChecker_TestHarness/Harness Inputs)
    baseline "BreakCAN_Fail_Baseline.mat"
      Brake_Pedal_Pressed:1
      AT_Selector_State:1
      Vehicle_Speed_km_h:1: abs tol 1
      CAN_BUS_Fail_Mode:1

  case "ATselectorCAN_Fail" [baseline]
    model Control_model, harness CANChecker_TestHarness (for Control_model/CAN Signal Checker)
    signal scenario: x2ATselectorCAN_Fail (CANChecker_TestHarness/Harness Inputs)
    baseline "ATselectorCAN_Fail_Baseline.mat"
      Brake_Pedal_Pressed:1
      AT_Selector_State:1
      Vehicle_Speed_km_h:1: abs tol 1
      CAN_BUS_Fail_Mode:1

  case "SpeedCAN_Fail" [baseline]
    model Control_model, harness CANChecker_TestHarness (for Control_model/CAN Signal Checker)
    signal scenario: x3SpeedCAN_Fail (CANChecker_TestHarness/Harness Inputs)
    baseline "SpeedCAN_Fail_Baseline.mat"
      Brake_Pedal_Pressed:1
      AT_Selector_State:1
      Vehicle_Speed_km_h:1: abs tol 1
      CAN_BUS_Fail_Mode:1

suite "Integrated_test"

  case "Normal Driving" [baseline]
    model Harness, harness ControlModel_IntegratedHarness (for Harness/Model)
    test sequence scenario: Normal (ControlModel_IntegratedHarness/Test Sequence)
    baseline "Integ_Normal_Baseline.mat"
      AutomaticTransmissionState
      CAN BUS Fail Mode
      Sensor Fail Mode
      TorqueRequest_Nm
      TorqueRequest_Nm
      AutomaticTransmissionState
      Sensor Fail Mode
      CAN BUS Fail Mode

  case "Throttle_Pedal_Fail" [baseline]
    model Harness, harness ControlModel_IntegratedHarness (for Harness/Model)
    test sequence scenario: Throttle_Pedal_Fail (ControlModel_IntegratedHarness/Test Sequence)
    baseline "Integ_ThrottlePedalFail_Baseline.mat"
      TorqueRequest_Nm

  case "BreakCAN_Fail" [baseline]
    model Harness, harness ControlModel_IntegratedHarness (for Harness/Model)
    test sequence scenario: BrakePedalCAN_Fail (ControlModel_IntegratedHarness/Test Sequence)
    baseline "Integ_BrakePedalCANFail_Baseline.mat"
      TorqueRequest_Nm

  case "ATselectorCAN_Fail" [baseline]
    model Harness, harness ControlModel_IntegratedHarness (for Harness/Model)
    test sequence scenario: ATstateCAN_Fail (ControlModel_IntegratedHarness/Test Sequence)
    baseline "Integ_ATstateCANFail_Baseline.mat"
      TorqueRequest_Nm

  case "SpeedCAN_Fail" [baseline]
    model Harness, harness ControlModel_IntegratedHarness (for Harness/Model)
    test sequence scenario: SpeedCAN_Fail (ControlModel_IntegratedHarness/Test Sequence)
    baseline "Integ_SpeedCANFail_Baseline.mat"
      CAN BUS Fail Mode